# Grasshopper definition gate.gh (Grasshopper 0.9.76)
# plug-ins: GHAddons

gate = Gate(Data=Toggle(False), Data_2=Toggle(True))  # -> Data, Data_2
panel = Panel(gate.Data)
panel_2 = Panel(gate.Data_2)
