# Grasshopper definition key_lookup.gh (Grasshopper 0.9.76)
# plug-ins: GHAddons

series = Series(Start=0, Step=1, Count=Slider(1000, range=10..10000))
keylookup = KeyLookup(Keys=series, Values=series, Search=series)
keysearch = KeyValueSearch(Keys=series, Values=series, Search=series)
