# Grasshopper definition member_index.gh (Grasshopper 0.9.76)
# plug-ins: GHAddons

series = Series(Start=0, Step=1, Count=Slider(5000, range=10..10000))
mindex = MemberIndex(Set=series, Member=series)  # -> simplify(Index), Count
memberindex = MemberIndex(List=series, Members=series)  # -> Indices, Count
panel = Panel(mindex.Count)
panel_2 = Panel(mindex.Index)
panel_3 = Panel(memberindex.Indices)
panel_4 = Panel(memberindex.Count)
