# Grasshopper definition replace_member.gh (Grasshopper 0.9.76)
# plug-ins: GHAddons

number_slider = Slider(10000, range=10..10000)
number_slider_2 = Slider(0.1, range=0..0.1)
division = Division(A=number_slider, B=2)
series = Series(Start=0, Step=2, Count=division)
lng = ListLength(List=series)
series_2 = Series(Start=0, Step=1, Count=number_slider)
dup = DuplicateData(Data=0, Number=lng, Order=True)
addition = Addition(A=series, B=number_slider_2)
addition_2 = Addition(A=series_2, B=number_slider_2)
replace = ReplaceMembers(Set=addition_2, Find=addition, Replace=dup)
replacemembers = ReplaceMembers(List=addition_2, Find=addition, Replace=dup)
panel = Panel(replacemembers)
panel_2 = Panel(replace)
