# Grasshopper definition server.gh (Grasshopper 0.9.76)
# plug-ins: Python Interpreter, GHAddons

server = Server(In=Toggle(True), Port=Slider(1234, range=0..10000))
python = PythonScript(x=server)  # -> out, a, b
# ---------- python: Python ----------
import json
import Rhino.Geometry as rg;

d = json.loads(x)


a = map(rec, d)
b = map(lambda x: x[4].replace('rgb(','').replace(')',''), d)

def rec(p):
    p1 = rg.Point3d(p[0], p[1], 0)
    p2 = rg.Point3d(p[2], p[3], 0)
    return rg.Rectangle3d(rg.Plane.WorldXY, p1, p2)
# ---------- end python ----------
boundary = BoundarySurfaces(Edges=python.a)
col = Colour(python.b)
preview = CustomPreview(Geometry=boundary, Shader=col)
