# Grasshopper definition storage.gh (Grasshopper 0.9.76)
# plug-ins: GHAddons, PathTool

number_slider = Slider(300, range=1..10000)
pathtool = PathTool(RelPath="my.db")
series = Series(Start=0, Step=1, Count=number_slider)
series_2 = Series(Start=0, Step=Slider(1, range=1..100), Count=number_slider)
reader = Reader(Key=series)
writer = Writer(Key=series, Value=series_2)
storage = Storage(Button=pathtool)
panel = Panel(reader)
