# Grasshopper definition tiles.gh (Grasshopper 0.9.76)
# plug-ins: Python Interpreter, treesloth01, GrasshopperAddons

rec = Rectangle({Plane=PlaneXY(0.04380166444, -0.0003785434315, 0), Size=Domain2(u=0..19.95831955, v=0..15.02837607)})
drec = DeconstuctRectangle(Rectangle=rec)  # -> BasePlane, XInterval, YInterval
deplane = DeconstructPlane(Plane=drec.BasePlane)  # -> Origin, XAxis, YAxis, ZAxis
rec_2 = Rectangle({Plane=PlaneXY(0.04380166444, -0.0003785434315, 0), Size=Domain2(u=0..19.95831955, v=0..15.02837607)})
drec_2 = DeconstuctRectangle(Rectangle=rec_2)  # -> BasePlane, XInterval, YInterval
deplane_2 = DeconstructPlane(Plane=drec_2.BasePlane)  # -> Origin, XAxis, YAxis, ZAxis
rec_3 = Rectangle([{Plane=PlaneXY(0.6568485085, 12.34867597, 0), Size=Domain2(u=0..3.972218781, v=0..2.197397623)}, {Plane=PlaneXY(6.023569627, 12.30641832, 0), Size=Domain2(u=0..4.521568187, v=0..2.11288233)}, {Plane=PlaneXY(12.02415544, 12.17964538, 0), Size=Domain2(u=0..4.141249367, v=0..2.155139977)}, {Plane=PlaneXY(1.831935602, 1.407938992, 0), Size=Domain2(u=0..4.799633935, v=0..2.243307165)}, {Plane=PlaneXY(8.092327691, 0.9384095858, 0), Size=Domain2(u=0..4.22576466, v=0..2.660666638)}, {Plane=PlaneXY(14.14404004, 1.25142919, 0), Size=Domain2(u=0..4.382274463, v=0..2.451986902)}])
rec_4 = Rectangle([{Plane=PlaneXY(0.6568485085, 12.34867597, 0), Size=Domain2(u=0..3.972218781, v=0..2.197397623)}, {Plane=PlaneXY(6.023569627, 12.30641832, 0), Size=Domain2(u=0..4.521568187, v=0..2.11288233)}, {Plane=PlaneXY(12.02415544, 12.17964538, 0), Size=Domain2(u=0..4.141249367, v=0..2.155139977)}, {Plane=PlaneXY(1.831935602, 1.407938992, 0), Size=Domain2(u=0..4.799633935, v=0..2.243307165)}, {Plane=PlaneXY(8.092327691, 0.9384095858, 0), Size=Domain2(u=0..4.22576466, v=0..2.660666638)}, {Plane=PlaneXY(14.14404004, 1.25142919, 0), Size=Domain2(u=0..4.382274463, v=0..2.451986902)}])
rec_5 = Rectangle({Plane=PlaneXY(4.611882604, 5.407034777, 0), Size=Domain2(u=0..7.792491297, v=0..4.691397821)})
rec_6 = Rectangle({Plane=PlaneXY(6.253568188, 4.585989442, 0), Size=Domain2(u=0..8.050915753, v=0..6.762769232)})
pt = ConstructPoint(XCoordinate=0, YCoordinate=0, ZCoordinate=0)
rec_7 = Rectangle({Plane=PlaneXY(4.611882604, 5.407034777, 0), Size=Domain2(u=0..7.792491297, v=0..4.691397821)})
rec_8 = Rectangle({Plane=PlaneXY(6.253568188, 4.585989442, 0), Size=Domain2(u=0..8.050915753, v=0..6.762769232)})
pt_2 = ConstructPoint(XCoordinate=0, YCoordinate=0, ZCoordinate=0)
rec_9 = Rectangle(rec_3)
rec_10 = Rectangle(rec_4)
panel = Panel("http://vpp-sql04/stageapi/")
panel_2 = Panel("28000")
cluster = Cluster(R=rec, V=pt)
cluster_2 = Cluster(R=rec_6, V=deplane.Origin)
cluster_3 = Cluster(R=rec_9, V=deplane.Origin)
cluster_4 = Cluster(R=rec_2, V=pt_2)
cluster_5 = Cluster(R=rec_8, V=deplane_2.Origin)
lng = ListLength(List=rec_9)
cluster_6 = Cluster(R=rec_10, V=deplane_2.Origin)
lng_2 = ListLength(List=rec_10)
dup = DuplicateData(Data="28001", Number=lng, Order=True)
dup_2 = DuplicateData(Data="28001", Number=lng_2, Order=True)
api = НастройкиAPI(Адрес="http://localhost:51798/")
merge = Merge(Data1=cluster_4, Data2=cluster_2)  # -> simplify(graft(Result))
panel_4 = Panel("""2787967b-f030-4a50-9cce-08d60dcab6dc
2787967b-f030-4a50-9cce-08d60dcab6dc""")
cluster_7 = Cluster_2(data=cluster_4, path="{0;1}")
cluster_8 = Cluster_2(data=cluster_4, path="{0;0}")
cluster_9 = Cluster_2(data=cluster, path="{1;1}")
cluster_10 = Cluster_2(data=cluster_6, path="{0;1}")
cluster_11 = Cluster_2(data=cluster_6, path="{0;0}")
cluster_12 = Cluster_2(data=cluster_3, path="{1;1}")
cluster_13 = Cluster_2(data=dup_2, path="{0;1}")
cluster_14 = Cluster_2(data=dup_2, path="{0;0}")
cluster_15 = Cluster_2(data=dup, path="{1;1}")
append_element = AppendElement(Data=merge, Index=1)
merge_2 = Merge(Data1=cluster_8, Data2=cluster_7, Data3=cluster_9)
merge_3 = Merge(Data1=cluster_11, Data2=cluster_10, Data3=cluster_12)
merge_4 = Merge(Data1=cluster_14, Data2=cluster_13, Data3=cluster_15)
runner = Runner(Кнопка=Button())
item = ListItem(List=panel_4, Index=Slider(1, range=1..10), Wrap=True)
python = PythonScript(x=panel_4)  # -> out, a; inputs x: list
# ---------- python: Python ----------
import json
r = {'guids': x}
a = json.dumps(x)
# ---------- end python ----------
плитки = Плитки(Запуск=runner, PanelVersion=panel_4, Body=merge_2, Openings=append_element, Tiles=merge_3, VendorCodes=merge_4)
python_2 = PythonScript(x=item)  # -> out, a
# ---------- python_2: Python ----------
a = "http://localhost:51798/v1/panels/panelVersions/"+x+"/layouts"
# ---------- end python_2 ----------
runner_2 = Runner(Кнопка=Button())
panel_5 = Panel(плитки)
httprequest = HttpRequest(Запуск=runner_2, Method="post", Url=python_2.a, Data=python.a)
panel_6 = Panel(httprequest)

# ==== cluster Cluster
V = ClusterInput()
R = ClusterInput()
drec = DeconstuctRectangle(Rectangle=R)  # -> BasePlane, XInterval, YInterval
deplane = DeconstructPlane(Plane=drec.BasePlane)  # -> Origin, XAxis, YAxis, ZAxis
dedomain = DeconstructDomain(Domain=drec.YInterval)  # -> Start, End
dedomain_2 = DeconstructDomain(Domain=drec.XInterval)  # -> Start, End
devec = DeconstructVector(Vector=deplane.Origin)  # -> XComponent, YComponent, ZComponent
devec_2 = DeconstructVector(Vector=V)  # -> XComponent, YComponent, ZComponent
addition = Addition(A=dedomain.End, B=devec.YComponent)
addition_2 = Addition(A=dedomain.Start, B=devec.YComponent)
addition_3 = Addition(A=dedomain_2.End, B=devec.XComponent)
addition_4 = Addition(A=dedomain_2.Start, B=devec.XComponent)
subtraction = Subtraction(A=addition_2, B=devec_2.YComponent)
subtraction_2 = Subtraction(A=addition, B=devec_2.YComponent)
subtraction_3 = Subtraction(A=addition_4, B=devec_2.XComponent)
subtraction_4 = Subtraction(A=addition_3, B=devec_2.XComponent)
dom²num = ConstructDomain²(UMin=subtraction_3, UMax=subtraction_4, VMin=subtraction, VMax=subtraction_2)
i² = ClusterOutput(dom²num)

# ==== cluster Cluster_2
data = ClusterInput()
path = ClusterInput()
data_2 = Data(data)
tstat = TreeStatistics(Tree=data_2)  # -> Paths, Length, Count
path_2 = DataPath(path)
replace = ReplacePaths(Data=data_2, Search=tstat.Paths, Replace=path_2)
D = ClusterOutput(replace)
